% Simulink data dictionary Adblue_Level_and_heater_DD.sldd

Ambiant_Temp = Simulink.Parameter([-40 -39 -38 -37 -36 -35 -34 -33 -32 -31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 60], DataType="int8")
level_sensor = Simulink.Parameter([1 2 3 4 5 6 7 8 9 10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 100], DataType="uint8", Min=1, Max=100)