% Simulink data dictionary DPF_Regeneration_DD.sldd

Accelerator_pedal = Simulink.Parameter([0 1], DataType="boolean")
Push_button = Simulink.Parameter([0 1], DataType="boolean")
SCR_bed_Temp = Simulink.Parameter([1 2 3 4 5 6 7 8 9 10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 700], DataType="uint16", Unit="°C")
brake_peadal = Simulink.Parameter([0 1], DataType="boolean")
clutch_pedal = Simulink.Parameter([0 1], DataType="boolean")
soot_Deposition = Simulink.Parameter([0 1], DataType="int8")