% Simulink data dictionary Integrated_Model_DD.sldd

ADblue_CONC_MAX = Simulink.Parameter(34, DataType="int8")
ADblue_CONC_MIN = Simulink.Parameter(33, DataType="int8")
ADblue_LEVEL_MAX = Simulink.Parameter(30, DataType="int8")
ADblue_LEVEL_MIN = Simulink.Parameter(15, DataType="int8")
DPF_TEMP_REQ = Simulink.Parameter(500, DataType="uint16")
FLOW_RATE_MIN = Simulink.Parameter(4.8, DataType="double")
HEATER = Simulink.Parameter(5, DataType="int8")
NOX_DOWN = Simulink.Parameter(10, DataType="int8")
O2_concentration_max = Simulink.Parameter(14, DataType="int8")
O2_concentration_min = Simulink.Parameter(8, DataType="int8")
PRESSURE_REQ = Simulink.Parameter(5.8, DataType="double")
REG_TIME_OFF = Simulink.Parameter(25, DataType="int8")
SCR_BED_TEMP_MIN = Simulink.Parameter(200, DataType="uint8")
TIMER = Simulink.Parameter(0.1, DataType="double")
Time_off = Simulink.Parameter(0, DataType="boolean")
Time_on = Simulink.Parameter(1, DataType="boolean")
soot_max = Simulink.Parameter(0.45, DataType="double")
soot_mil = Simulink.Parameter(0.9, DataType="double")
Accelerator_pedal = Simulink.Signal(DataType="boolean")
Adblue_cojncentration_check = Simulink.Signal(DataType="double")
Adblue_level = Simulink.Signal(DataType="double")
Ambiant_temp = Simulink.Signal(DataType="double")
Flow_Rate = Simulink.Signal(DataType="double")
NOx_Upstream = Simulink.Signal(DataType="double")
NOx_downstream = Simulink.Signal(DataType="double")
O2_Concentration = Simulink.Signal(DataType="double")
Pressure_sensor = Simulink.Signal(DataType="double")
Push_Button = Simulink.Signal(DataType="boolean")
SCR_Bed_temp = Simulink.Signal(DataType="double")
Soot = Simulink.Signal(DataType="double")
T2_temp_Sensor = Simulink.Signal(DataType="double")
brake_peadal = Simulink.Signal(DataType="boolean")
clutch_pedal = Simulink.Signal(DataType="boolean")