% Simulink data dictionary SCR_Injector_ON_Off_DD.sldd

Downstrame_NOx = Simulink.Parameter([1 2 3 4 5 6 7 8 9 10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 100], DataType="uint8", Unit="ppm")
NOx_Upstream = Simulink.Parameter([1 2 3 4 5 6 7 8 9 10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 600], DataType="uint16", Unit="ppm")
SCR_Bed_temp = Simulink.Parameter([1 2 3 4 5 6 7 8 9 10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 700], DataType="uint16", Unit="°C")